# Grasshopper definition 01_points_tokyo(fig1,4).gh (Grasshopper 1.0.8)
# plug-ins: Human, Heron, eleFront5

# ----
# SET ANCHOR POINT
panel = Panel("Victoria Park, London")
restgeocode = ESRIRESTServiceGeocode(Addresses=panel)  # -> Candidates, Latitude, Longitude
lat = Panel("35.646589")
long = Panel("139.693243")
panel_2 = Panel(restgeocode.Candidates)
branch = TreeBranch(Tree=restgeocode.Candidates, Path="0;0", MaintainPaths=True)
branch_2 = TreeBranch(Tree=restgeocode.Latitude, Path="0;0", MaintainPaths=True)
branch_3 = TreeBranch(Tree=restgeocode.Longitude, Path="0;0", MaintainPaths=True)
panel_3 = Panel(branch)
seteap = SetEarthAnchorPoint(SetEAP=Toggle(True), Latitude=branch_2, Longitude=branch_3)

path = FilePath("C:\Users\taiga\Desktop\UCL\RC15\Skills\SUBMISSION\01\point_tokyo.csv")
file = ReadFile(File=path, PerLineParse=True)
panel_4 = Panel(file)
cull_i = CullIndex(List=file, Indices="0", Wrap=True)
tab = Panel(",")
split = TextSplit(Text=cull_i, Separators=tab)
panel_5 = Panel(split)
item = ListItem(List=split, Index="3", Wrap=True)  # -> Item, Item1

seteap_2 = SetEarthAnchorPoint(SetEAP=Button(), Latitude=lat, Longitude=long)
split_2 = TextSplit(Text=split, Separators="\t")
py3 = Python3Script(x=item.Item1)  # -> out, a
# ---------- py3: Python ----------
# Convert x to a decimal (float)
try:
    a = float(x)
except:
    result = None
# ---------- end py3 ----------
flatten = FlattenTree(Tree=py3.a, Path="{0}")
py3_2 = Python3Script(x=item.Item)  # -> out, a; same code as py3
flatten_2 = FlattenTree(Tree=py3_2.a, Path="{0}")

flatten_3 = FlattenTree(Tree=item.Item, Path="{0}")
flatten_4 = FlattenTree(Tree=item.Item1, Path="{0}")
# CONVERT COORDINATES TO XY VALUES
ddtoxy = DecimalDegreesToXY(Latitude=flatten_2, Longitude=flatten)  # -> XyPoint, Transform
geo = Geometry(ddtoxy.XyPoint)
panel_6 = Panel(ddtoxy.XyPoint)

# ----
# Bake with attributes (optional)
item_2 = ListItem(List=split, Index="12", Wrap=True)
tstat = TreeStatistics(Tree=item_2)  # -> Paths, Length, Count
dup = DuplicateData(Data="Sentiment", Number=tstat.Length, Order=True)  # -> simplify(Data)
ef_att = EleFrontAttributes(Keys=dup, Values=item_2, Layer="Points", maintainBakeName=False)  # -> flatten(Attributes), Keys, Values, Name, Layer, ColourSource, DisplayColour, MaterialSource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
bake = BakeObjects(Geometry=geo, Attributes=ef_att.Attributes, Bake=Button(), createGroups=False)  # -> Message, Ghosts

panel_7 = Panel(flatten_2)
panel_8 = Panel(item_2)
pt = Point(ddtoxy.XyPoint)
cir = Circle(Plane=pt, Radius=Slider(500, range=0..1000))
item_3 = ListItem(List=split, Index="12", Wrap=True)
boundary = BoundarySurfaces()
panel_9 = Panel(py3_2.a)
panel_10 = Panel(py3.a)
py3_3 = Python3Script(x=item_3)  # -> out, a; same code as py3
dom = ConstructDomain(DomainStart="-1", DomainEnd="1")
panel_11 = Panel(py3_3.a)
remap = RemapNumbers(Value=py3_3.a, Source=dom, Target=Domain(0, 1))  # -> Mapped, Clipped
gradient = Gradient(
    LowerLimit="0",
    UpperLimit="1",
    Parameter=remap.Mapped,
    stops=[0: RGB(30, 144, 255), 0.352: RGB(30, 144, 255), 0.503: RGB(255, 255, 255), 0.651: RGB(255, 128, 128), 1: RGB(255, 0, 0)])
gradient_2 = Gradient(
    LowerLimit="0",
    UpperLimit="1",
    stops=[0.0988: RGB(128, 128, 255), 0.351: RGB(128, 255, 128), 0.498: RGB(255, 255, 128), 0.651: RGB(255, 128, 0), 0.897: RGB(220, 0, 40)])
gradient_3 = Gradient(
    LowerLimit=0,
    UpperLimit=1,
    stops=[0: RGB(227, 190, 220), 0: RGB(128, 128, 255), 0.5: RGB(255, 255, 255), 0.753: RGB(255, 128, 128)])
gradient_4 = Gradient(
    LowerLimit=0,
    UpperLimit=1,
    stops=[0: RGB(48, 18, 59), 0.0294: RGB(56, 40, 112), 0.0588: RGB(63, 62, 156), 0.0882: RGB(68, 82, 193), 0.118: RGB(70, 102, 221), 0.147: RGB(71, 122, 241)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])
createatts = CreateAttributes(Color=gradient, enableFullPath=False)
preview = CustomPreview(Geometry=flatten(cir), Material=flatten(gradient))
bake_2 = BakeGeometry(Bake=Button(), Geometry=flatten(cir), Attributes=flatten(createatts), DeleteOldBakes=False, PreserveTrees=False)
