# Grasshopper definition 02_lines_tokyo(fig5).gh (Grasshopper 1.0.8)
# plug-ins: Human, eleFront5

geo = Geometry([<point referenced from the Rhino model> x5000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])
getkv = GetAllKeysValues(AttributesOrAttributedGeometry=geo)  # -> Keys, simplify(flatten(Values)), BakeName
multiplication = Multiplication(A="150000", B=getkv.Values)
Z = UnitZ(Factor=multiplication)
move = Move(Geometry=geo, Motion=Z)  # -> Geometry, Transform
pdecon = Deconstruct(Point=Z)  # -> XComponent, YComponent, ZComponent
ln = Line(StartPoint=geo, EndPoint=move.Geometry)
bnd = Bounds(Numbers=pdecon.ZComponent)
dedomain = DeconstructDomain(Domain=bnd)  # -> Start, End
panel = Panel(bnd)
gradient = Gradient(
    LowerLimit=dedomain.Start,
    UpperLimit=dedomain.End,
    Parameter=pdecon.ZComponent,
    stops=[0: RGB(128, 128, 255), 0.5: RGB(255, 255, 255), 1: RGB(255, 128, 128)])
cir = Circle(Plane=move.Geometry, Radius=Slider(1, range=0..10))
srf = Surface(cir)
createatts = CreateAttributes(Color=gradient, enableFullPath=False)
preview = CustomPreview(Geometry=ln, Material=gradient)
bake = BakeGeometry(Bake=Button(), Geometry=ln, Attributes=createatts, DeleteOldBakes=False, PreserveTrees=False)
